# Grasshopper definition Example2.gh (Grasshopper 1.0.7)
# plug-ins: Coral, Weaverbird, MeshEdit Components, Kangaroo2 Components

X = Integer(Slider(240, range=0..1000))
Y = Integer(Slider(40, range=0..1000))
X_2 = Integer(X)
Y_2 = Integer(Y)
number_slider = Slider(1, range=0..10)
X_3 = Integer(X)
Y_3 = Integer(Y)
planesrf = PlaneSurface(Plane=PlaneXY(0, 0, 0), XSize=X_2, YSize=Y_2)
Y_4 = Integer(Y)
multiplication = Multiplication(A=Y_3, B=2)
multiplication_2 = Multiplication(A=X_3, B=2)
multiplication_3 = Multiplication(A=Y_4, B=0.5)
mesh_uv = MeshSurface(Surface=planesrf, UCount=X_3, VCount=Y_3, Overhang=True, Equalize=False)
wbnaked = WeaverbirdsNakedBoundary(MeshClosedPolylines=mesh_uv)
explode = Explode(Curve=wbnaked, Recursive=True)  # -> Segments, Vertices
addition = Addition(A=multiplication_3, B=number_slider)
subtraction = Subtraction(A=multiplication_3, B=number_slider)
X_4 = Integer(X)
X_5 = Integer(X)
pdecon = Deconstruct(Point=explode.Vertices)  # -> XComponent, YComponent, ZComponent
pt = ConstructPoint(XCoordinate=X_5, YCoordinate=addition, ZCoordinate=0)
equals = Equality(FirstNumber=pdecon.XComponent, SecondNumber="0")  # -> Equality, Inequality
pt_2 = ConstructPoint(XCoordinate=X_4, YCoordinate=subtraction, ZCoordinate=0)
dispatch = Dispatch(List=explode.Vertices, DispatchPattern=equals.Equality)  # -> ListA, ListB
ln = Line(StartPoint=pt_2, EndPoint=pt)
line = Line(Line((120, 40, 0), (120, 69.35764989, 0)))
neg = Negative(Value="1")
pline = PolyLine(Vertices=dispatch.ListA, Closed=False)
line_2 = Line([Line((240, 0, 0), (240, -31.15575056, 0)), Line((0, 0, 0), (0, -31.15575056, 0))])
load2d = Load2D(Curves=line, Mesh=mesh_uv, X=0, Y=neg, Threshold=0.01)  # -> Load2D, Indices
support2d = Support2D(Curves=line_2, Mesh=mesh_uv, X=0, Y=0, Threshold=0.01)  # -> Support2D, Indices
material = Material(YoungsModulus=1, PoissonsRatio=0.3)
pixelelement = PixelElement(Mesh=mesh_uv, Material=material, Load2D=load2d.Load2D, Support2D=support2d.Support2D)
explode_2 = MeshExplode(Mesh=mesh_uv, Interpolate=False)
gettopoptresult = GetTopOptResult(Path="E:\ALCoding\ALFE\topoptTest\Example2\solution", Elems=explode_2, Iteration=Slider(41, range=0..100))  # -> Info, Elems, VertSensitivities, ElemSensitivities
panel = Panel(gettopoptresult.Info)
beso = BESOTopOpt(
    Path="E:\ALCoding\ALFE\topoptTest\Example2\beso2",
    Model=pixelelement,
    VolumeFraction=Slider(0.5, range=0..1),
    FilterRadius=Slider(2, range=0..10),
    EvolutionRate=Slider(0.02, range=0..0.1),
    PenaltyExponent=Slider(3, range=0..10),
    MaximumIteration=200,
    Solver=Slider(4, range=0..10))  # -> BESOSystem, Model
mjoin = MeshJoin(Meshes=gettopoptresult.Elems)
area = MeshArea(Mesh=mjoin)  # -> Area, Centroid
marchingsquares = MarchingSquares(Mesh=mesh_uv, Values=gettopoptresult.VertSensitivities, Isovalue=Slider(0.005552, range=0..1), Solid=Toggle(False))  # -> Meshes, Cases
area_2 = MeshArea(Mesh=marchingsquares.Meshes)  # -> Area, Centroid
subtraction_2 = Subtraction(A=area.Area, B=area_2.Area)
wbnaked_2 = WeaverbirdsNakedBoundary(MeshClosedPolylines=marchingsquares.Meshes)
boundary = BoundarySurfaces(Edges=wbnaked_2)
mesh = MeshBrep(
    Brep=boundary,
    Settings={GridMaxCount=0, GridMinCount=16, JaggedSeams=False, MaxEdgeLength=0, MinEdgeLength=0.0001, MinTolerance=0, Refine=True, RefineAngle=0, RelativeTolerance=0.65, SimplePlanes=True, Tolerance=0})
triremesh = TriRemesh(Geometry=mesh, Sharp=False, Length=Slider(1.74, range=0..10), Iterations=25)  # -> Triangulation, Dual, Creases; disabled
load2d_2 = Load2D(Curves=line, Mesh=triremesh.Triangulation, X=0, Y=neg, Threshold=Slider(0.49, range=0..10))  # -> Load2D, Indices
support2d_2 = Support2D(Curves=line_2, Mesh=triremesh.Triangulation, X=0, Y=0, Threshold=0.01)  # -> Support2D, Indices
triangular_element = TriangularElement(Mesh=triremesh.Triangulation, Material=material, Load2D=load2d_2.Load2D, Support2D=support2d_2.Support2D)
galapagos = Galapagos()
abs = Absolute(Value=subtraction_2)
panel_2 = Panel(area.Area)
panel_3 = Panel(area_2.Area)
beso_2 = BESOTopOpt(
    Path="E:\ALCoding\ALFE\topoptTest\2DCases\beso2",
    Model=triangular_element,
    VolumeFraction=Slider(0.5, range=0..1),
    FilterRadius=Slider(2, range=0..10),
    EvolutionRate=Slider(0.02, range=0..0.1),
    PenaltyExponent=Slider(3, range=0..10),
    MaximumIteration=200,
    Solver=Slider(4, range=0..10))  # -> BESOSystem, Model
panel_4 = Panel(abs)
